# Dynamo graph Baitap1.dyn (Dynamo 2.10.1.3976)

code_block = CodeBlock { 1..100..5; }
code_block_2 = CodeBlock { 5; }
byCoordinates = Point.ByCoordinates(x=code_block, y=code_block_2)
code_block_3 = CodeBlock { 10; }
byCoordinates_2 = Point.ByCoordinates(x=code_block, y=code_block_3)
code_block_4 = CodeBlock { 1; }
dropItems = List.DropItems(list=byCoordinates_2, amount=code_block_4)
byStartPointEndPoint = Line.ByStartPointEndPoint(startPoint=byCoordinates, endPoint=dropItems)
byCoordinates_3 = Point.ByCoordinates(x=code_block)
code_block_5 = CodeBlock { 1; }
dropItems_2 = List.DropItems(list=byCoordinates_3, amount=code_block_5)
byStartPointEndPoint_2 = Line.ByStartPointEndPoint(startPoint=byCoordinates, endPoint=dropItems_2)
code_block_6 = CodeBlock { 1; }
dropItems_3 = List.DropItems(list=byCoordinates, amount=code_block_6)
byStartPointEndPoint_3 = Line.ByStartPointEndPoint(startPoint=dropItems_3, endPoint=byCoordinates_3)
byStartPointEndPoint_4 = Line.ByStartPointEndPoint(startPoint=dropItems_3, endPoint=byCoordinates_2)
